# Grasshopper definition DB DEV Materials.ghx (Grasshopper 1.0.8)

# ---- group: Lime plaster
water_absorption_coefficient_kg_m2h1_2 = Panel("3")
water_content_at_rh80_kg_m3 = Panel("30")
free_water_saturation_kg_m3 = Panel("250")
moisture_content_m3_m3 = Panel("""0
0.02
0.03
0.05
0.07
0.18
0.25""")
isotherm_rh = Panel("""0
0.5
0.8
0.9
0.93
0.99
1""")
dry_density_kg_m3 = Panel("1600")
kalkputz_from_masea = Panel("DB Lime Plaster")
processmasea = DBProcessMASEAData(
    density=dry_density_kg_m3,
    absorpt_coeff=water_absorption_coefficient_kg_m2h1_2,
    w_80=water_content_at_rh80_kg_m3,
    w_f=free_water_saturation_kg_m3,
    sorption_w_m3m3=moisture_content_m3_m3,
    sorption_rh=isotherm_rh)  # -> initial_w, sorption_w, sorption_rh, suction_w, suction_coeff, redist_w, redist_coeff; inputs sorption_w_m3m3: list, sorption_rh: list
# ---------- processmasea: Python ----------
"""
Process moisture-related data collected from the MASEA database into properties 
that can be plugged in the "HygroMat" component to create a hygrothermal material.
_
Link to MASEA: https://www.masea-ensan.com/

    Args:
        _density: Number for the density of the material [kg/m3].
            
        _absorpt_coeff: Number for the water absorption coefficient (A) [kg/(m2h1/2)]
            
        _w_80: Number for the water content at RH=80% [kg/m3]

        _w_f: Number for the water content at free saturation [kg/m3]
             
        _sorption_w_m3m3: A list of moisture contents for the sorption isotherm [m3/m3]
            This list must have the same length as _sorption_rh.
            _
            Note that the units are in m3/m3.
        _sorption_rh: A list of relative humidities between 0 and 1 for the 
            sorption isotherm [-].
            This list must have the same length as _sorption_w_m3m3.
            
    Returns:
        _initial_w: A number for the initial water content ratio [kg/kg]
            _
            This corresponds to _w_80 converted in kg/kg
        _sorption_w: A list of moisture contents for the sorption isotherm [kg/m3]
            This list must have the same length as _sorption_rh.
        _sorption_rh: A list of relative humidities between 0 and 1 for the 
            sorption isotherm [-].
        suction_w: A list of moisture contents for the liquid suction [kg/m3]
        suction_coeff: A list of (moisture-dependent) suction coefficients for 
            the liquid suction [m2/s].
        redist_w: A list of moisture contents for the liquid redistribution [kg/m3]
        redist_coeff: A list of (moisture-dependent) redistribution coefficients 
            for the liquid redistribution [m2/s].
        
"""

ghenv.Component.Name = "DB Process MASEA Data"
ghenv.Component.NickName = 'ProcessMASEA'
ghenv.Component.Message = '0.0.1'
ghenv.Component.Category = 'Dewbee'
ghenv.Component.SubCategory = "1 :: Constructions"

# Turn off the "old" tag
import ghpythonlib as ghlib
c = ghlib.component._get_active_component()
c.ToggleObsolete(False)

try:  # import ladybug_rhino dependencies
    from ladybug_rhino.grasshopper import all_required_inputs
except ImportError as e:
    raise ImportError('\nFailed to import ladybug_rhino:\n\t{}'.format(e))

# Suction liquid transport coefficient
# Based on moisture content (w) and free water saturation (wf)
def suction(A, w_f, w):
    if w <= 0: # start with 0
        return 0.0
    value = 3.8*(A/w_f)**2*1000**(w/w_f - 1)
    return max(value, 1e-15) # avoiding tiny values here
    
# Space moisture points geometrically to increase resolution near wf
def moisture_grid(w_f, n):
    return [w_f*(i/n)**2 for i in range(n+1)]


if all_required_inputs(ghenv.Component):
    # Convert (kg/m2h1/2) to (kg/m2s1/2)
    A_SI = _absorpt_coeff/60

    n_steps = 10
    suction_w = moisture_grid(_w_f, n_steps)
    suction_coeff = [suction(A_SI, _w_f, w) for w in suction_w]
    
    redist_w = suction_w
    redist_coeff = [v/10 for v in suction_coeff]
    
    initial_w = _w_80/_density
    
    sorption_w = [v*1000 for v in _sorption_w_m3m3]
    sorption_rh = _sorption_rh
    
    # Add w_f(RH=100%) if not already given
    if sorption_rh[-1] != 1 and _w_f > sorption_w[-1]:
        sorption_rh.append(1)
        sorption_w.append(_w_f)
# ---------- end processmasea ----------
thickness_m = Panel("0.03")
opaquemat = HBOpaqueMaterial(
    name=kalkputz_from_masea,
    thickness=thickness_m,
    conductivity="0.7",
    density=dry_density_kg_m3,
    spec_heat="850",
    therm_absp="0.64",
    sol_absp="0.70",
    vis_absp="0.70")  # -> mat; plug-in component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
hygromat = DBHygrothermalMaterial(
    mat=opaquemat,
    porosity="0.3",
    initial_w=processmasea.initial_w,
    sorption_w=processmasea.sorption_w,
    sorption_rh=processmasea.sorption_rh,
    suction_w=processmasea.suction_w,
    suction_coeff=processmasea.suction_coeff,
    redist_w=processmasea.redist_w,
    redist_coeff=processmasea.redist_coeff,
    diff_rh="0",
    diff_resist="7",
    conductivity_w="0",
    conductivity="0.7",
    info="Source: MASEA, Kalkputz")  # -> mat; inputs sorption_w: list, sorption_rh: list, suction_w: list, suction_coeff: list, redist_w: list, redist_coeff: list, diff_rh: list, diff_resist: list, conductivity_w: list, conductivity: list
# ---------- hygromat: Python ----------
"""
Create a hygrothermal opaque material from a standard HB opaque material, which 
can be plugged into the "HB Opaque Construction" component. 
_
Except for _porosity and _initial_w, all hygrothermal inputs must be entered as lists.
_ 
If you don't have enough data, use the standard "HB Opaque Material" instead. 
The HAMT model will only run on surfaces with constructions containing fully 
characterized hygrothermal properties. If all constructions are characterized, 
HAMT will be run for all surfaces.
_
Check MaterialProperty:HeatAndMoistureTransfer on EnergyPlus input-output documentation
for more information on the required inputs.
    Args:
        _mat: A standard HB opaque material object. For example, it can be the
        output of the "HB Opaque Material" component.
            
        _porosity: A number between 0 and 1 for the porosity.
        
        _initial_w_: A number for the initial water content ratio [kg/kg]
             _
             The initial water content is assumed to be distributed evenly through
             the depth of the material. UNITS ARE IN KG OF WATER PER KG OF DRY MATERIAL. (Default: 0)
             
        _sorption_w_: A list of moisture contents for the sorption isotherm [kg/m3]
            This list must have the same length as _sorption_rh. Required for hygroscopic materials.
            _
            EnergyPlus automatically sets w = 0 at rh = 0 and w = porosity*1000 
            at rh=1. If you provide values at rh=0 and rh=1, they override these defaults.
            Therefore, it is recommended to provide a point at rh=1 (w_f), because 
                orption should stop at a lower value, known as free saturation (w_f), because of air pockets
                trapped in the pore structure. For realistic predictions, remember 
            Supply increasing data up to the highest rh available for stability.
            _
            * Default *: when no curve is input, an artificial curve is created based
            on porosity. If at least w_80 and w_f are known, use the GenSorption component.
            
        _sorption_w_: A list of moisture contents for the sorption isotherm [kg/m3]
            This list must have the same length as _sorption_rh. Required for hygroscopic materials.
            _
            EnergyPlus automatically defines endpoints at rh = 0 (w = 0) and adds an
            internal maximum based on porosity. If you provide values at rh = 0 or 1,
            they override these defaults.
            _
            It is recommended to include a point at rh = 1.0 corresponding to free
            saturation (w_f), since real materials typically do not reach full pore
            saturation due to trapped air. This avoids overestimating moisture storage
            in the hygroscopic range.
            _
            Provide monotonically increasing values up to the highest available RH
            for numerical stability.
            _
            *Default*: If no curve is provided, an artificial isotherm is generated
            from porosity. If at least w_80 and w_f are known, use the GenSorption component.
        
        _sorption_rh_: A list of relative humidities between 0 and 1 for the 
            sorption isotherm [-]. Required for hygroscopic materials.
            This list must have the same length as _sorption_w.           
            
        _suction_w_: A list of moisture contents for the liquid suction [kg/m3]
            This list must have the same length as _suction_coeff. Required for capillary-active materials.
            _
            At least a datapoint at w = 0 is needed. The liquid coefficient at 
            the highest entered w is used for all values above this threshold. (Default: 0)

        _suction_coeff_: A list of (moisture-dependent) suction coefficients for 
            the liquid suction [m2/s]. Required for capillary-active materials.
            This list must have the same length as _suction_w
            _
            At least a datapoint at w = 0 is needed. The liquid coefficient at 
            the highest entered w is used for all values above this threshold.
            These coefficients are used when the rain flag is set in the epw. (Default: 0)
            
        _redist_w_: A list of moisture contents for the liquid redistribution [kg/m3].
            Required for capillary-active materials.
            This list must have the same length as _redist_coeff
            _
            At least a datapoint at w = 0 is needed. The liquid coefficient at 
            the highest entered w is used for all values above this threshold. (Default: 0)
            
        _redist_coeff_: A list of (moisture-dependent) redistribution coefficients 
            for the liquid redistribution [m2/s]. Required for capillary-active materials.
            This list must have the same length as _redist_w
             _
            At least a datapoint at w = 0 is needed. The liquid coefficient at 
            the highest entered w is used for all values above this threshold.
            These coefficients are used when the rain flag is NOT set in the epw. (Default: 0)
            
        _diff_rh: A list of relative humidities between 0 and 1 for the vapor 
            diffusion resistance factors [-].
            This list must have the same length as _diff_resist.
            _
            At least a datapoint at rh = 0 is needed. The diffusion resistance 
            factor at the highest entered rh is used for all values above this threshold.
        _diff_resist: A list of (moisture-dependent) vapor diffusion resistance 
            factors [-].
            This list must have the same length as _diff_rh.
            _
            At least a datapoint at rh = 0 is needed. The diffusion resistance 
            factor at the highest entered rh is used for all values above this threshold.
            
        _conductivity_w_: A list of moisture contents for the thermal conductivities [kg/m3]
            This list must have the same length as _conductivity.
            _
            At least a datapoint at w = 0 is needed (dry thermal conductivity). 
            The thermal conductivity at the highest entered w is used for all values 
            above this threshold. (Default: 0)
            
            
        _conductivity_: A list of (moisture-dependent) thermal conductivities [W/m-K] 
            This list must have the same length as _conductivity_w.
            _
            At least a datapoint at w = 0 is needed (dry thermal conductivity). 
            The thermal conductivity at the highest entered w is used for all values 
            above this threshold. (Default: dry conductivity from _mat)
            
        _info_: An optional string describing the material. This can be useful
            to document the source (e.g., MASEA).
    Returns:
        mat: A hygrothermal opaque material that can be assigned to a Honeybee
            Opaque construction.
"""

ghenv.Component.Name = "DB Hygrothermal Material"
ghenv.Component.NickName = 'HygroMat'
ghenv.Component.Message = '0.0.1'
ghenv.Component.Category = 'Dewbee'
ghenv.Component.SubCategory = "0 :: Constructions"

# Turn off the "old" tag
import ghpythonlib as ghlib
c = ghlib.component._get_active_component()
c.ToggleObsolete(False)

# Import dewbee dependencies
from dewbee import hygro_material
from dewbee import utils
reload(hygro_material)
reload(utils)
from dewbee.hygro_material import HygroMaterial
from dewbee.utils import rh_grid

try:  # import the honeybee-energy dependencies
    from honeybee_energy.material.opaque import EnergyMaterial
except ImportError as e:
    raise ImportError('\nFailed to import honeybee_energy:\n\t{}'.format(e))

try:  # import ladybug_rhino dependencies
    from ladybug_rhino.grasshopper import all_required_inputs
except ImportError as e:
    raise ImportError('\nFailed to import ladybug_rhino:\n\t{}'.format(e))

if all_required_inputs(ghenv.Component):
    # Set defaults
    if not _initial_w_:
        _initial_w_ = 0
    # Create artificial sorption curve
    if not _sorption_w_ and not _sorption_rh_:
        _sorption_rh_ = rh_grid()
        w_f = _porosity*0.05*1000 # assume w_f = 0.05*w_max 
        b = 1.01 # keeps the curve very steep
        _sorption_w_ = [w_f*(b-1)*rh/(b-rh) for rh in _sorption_rh_]
    if not _suction_w_ and not _suction_coeff_:
        _suction_w_ = [0]
        _suction_coeff_ = [0]
    if not _redist_w_ and not _redist_coeff_:
        _redist_w_ = [0]
        _redist_coeff_ = [0]
    if not _conductivity_w_ and not _conductivity_:
        _conductivity_w_ = [0]
        _conductivity_ = [_mat.conductivity]
    if not _info_:
        _info_ = ""
    mat = _mat.duplicate()
    identifier = mat.identifier
    hygro_mat = HygroMaterial(
        identifier,
        _porosity,
        _initial_w_,
        _sorption_w_,
        _sorption_rh_,
        _suction_w_,
        _suction_coeff_,
        _redist_w_,
        _redist_coeff_,
        _diff_rh,
        _diff_resist,
        _conductivity_w_,
        _conductivity_,
        )

    #Check if corresponding lists match
    hygro_mat.values_compatible()
    
    # Add HygroMaterial object as a dictionary to the standard EnergyMaterial
    mat.user_data = {"hygro_material": hygro_mat.to_dict(),
                     "info": _info_
                    }
# ---------- end hygromat ----------

# ----
panel = Panel("""0
6.27
15.97
23.86
32.35
40.84
71.38""")
panel_2 = Panel("""1.34
1.39
1.44
1.55
1.57
1.61
1.86""")
item = ListItem(List=panel_2, Index=0, Wrap=True)
opaquemat_2 = HBOpaqueMaterial(
    name="DB Rammed Earth",
    thickness="0.40",
    conductivity=item,
    density="1930",
    spec_heat="773",
    therm_absp="0.64",
    sol_absp="0.70",
    vis_absp="0.70")  # -> mat; plug-in component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
panel_3 = Panel("""20.5
18.6
18
15.1
13.8
12.7
7.05""")
panel_4 = Panel("""0
4.41e-10
6.64e-10
5.44e-10
6.04e-10
6.75e-10
7.42e-10
8.34e-10
9.42e-10""")
panel_5 = Panel("""0.055
0.25
0.31
0.425
0.48
0.68
0.88""")
panel_6 = Panel("Source: Losini, A. E. et al. Extended hygrothermal characterization of unstabilized rammed earth for modern construction. Construction and Building Materials 409, 133904 (2023).")
panel_7 = Panel("""0
4.41e-9
6.64e-9
5.44e-9
6.04e-9
6.75e-9
7.42e-9
8.34e-9
9.42e-9""")
panel_8 = Panel("""8.492
13.124
17.177
21.809
26.441
31.652
40.144
46.32
54.426
75.656""")
panel_9 = Panel("""0.09
0.2293
0.3542
0.4851
0.5896
0.6808
0.7863
0.842
0.8954
0.9836""")
panel_10 = Panel("""0
51.460914
55.788884
60.427519
64.906402
69.578136
73.607479
78.499961
84.139304""")
hygromat_2 = DBHygrothermalMaterial(
    mat=opaquemat_2,
    porosity="0.25",
    initial_w="0.04",
    sorption_w=panel_8,
    sorption_rh=panel_9,
    suction_w=panel_10,
    suction_coeff=panel_7,
    redist_w=panel_10,
    redist_coeff=panel_4,
    diff_rh=panel_5,
    diff_resist=panel_3,
    conductivity_w=panel,
    conductivity=panel_2,
    info=panel_6)  # -> mat; inputs sorption_w: list, sorption_rh: list, suction_w: list, suction_coeff: list, redist_w: list, redist_coeff: list, diff_rh: list, diff_resist: list, conductivity_w: list, conductivity: list; same code as hygromat

panel_11 = Panel("Source: EnergyPlus Reference DataSets, MoistureMaterials.idf")
opaquemat_3 = HBOpaqueMaterial(
    name="DB Glass Fiber Insulation",
    thickness="1.003",
    conductivity="0.04",
    density="80",
    spec_heat="840",
    roughness="Rough",
    therm_absp="0.9",
    sol_absp="0.70",
    vis_absp="0.70")  # -> mat; plug-in component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
panel_12 = Panel("""0.202
0.4325
0.6465
0.8465
0.948
0.978""")
panel_13 = Panel("""0.748
1.04
1.24
1.56
1.92
2.72""")
hygromat_3 = DBHygrothermalMaterial(
    mat=opaquemat_3,
    porosity="0.95",
    initial_w="0.1",
    sorption_w=panel_13,
    sorption_rh=panel_12,
    suction_w="0",
    suction_coeff="0",
    redist_w="0",
    redist_coeff="0",
    diff_rh="0",
    diff_resist="1.2543",
    info=panel_11)  # -> mat; inputs sorption_w: list, sorption_rh: list, suction_w: list, suction_coeff: list, redist_w: list, redist_coeff: list, diff_rh: list, diff_resist: list, conductivity_w: list, conductivity: list; same code as hygromat

opaquemat_4 = HBOpaqueMaterial(
    name="DB Cellulose Insulation",
    thickness="0.066",
    conductivity="0.04",
    density="55",
    spec_heat="1880",
    roughness="Rough",
    therm_absp="0.9",
    sol_absp="0.70",
    vis_absp="0.70")  # -> mat; plug-in component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
panel_14 = Panel("Source: EnergyPlus Reference DataSets, MoistureMaterials.idf")
panel_15 = Panel("""0
950""")
panel_16 = Panel("""0.04
0.583""")
panel_17 = Panel("""0.25
0.44
0.66
0.86
1""")
panel_18 = Panel("""2.365
4.62
6.655
11.4125
13""")
hygromat_4 = DBHygrothermalMaterial(
    mat=opaquemat_4,
    porosity="0.95",
    initial_w="0.001",
    sorption_w=panel_18,
    sorption_rh=panel_17,
    suction_w="0",
    suction_coeff="0",
    redist_w="0",
    redist_coeff="0",
    diff_rh="0",
    diff_resist="1.5",
    conductivity_w=panel_15,
    conductivity=panel_16,
    info=panel_14)  # -> mat; inputs sorption_w: list, sorption_rh: list, suction_w: list, suction_coeff: list, redist_w: list, redist_coeff: list, diff_rh: list, diff_resist: list, conductivity_w: list, conductivity: list; same code as hygromat

# ---- group: RE material
free_water_saturation_kg_m3_2 = Panel("253.47")
water_absorption_coefficient_kg_m2s1_2 = Panel("0.089")
opaquemat_5 = HBOpaqueMaterial(name="DB Stabilized Rammed Earth", thickness="0.30", conductivity="0.643", density="1900", spec_heat="868")  # -> mat; plug-in component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
panel_19 = Panel("Source: Allinson, D. & Hall, M. Hygrothermal analysis of a stabilised rammed earth test building in the UK. Energy and Buildings 42, 845–852 (2010).")
liquidcoeff = DBLiquidCoefficients(absorpt_coeff=water_absorption_coefficient_kg_m2s1_2, w_f=free_water_saturation_kg_m3_2)  # -> suction_w, suction_coeff, redist_w, redist_coeff
# ---------- liquidcoeff: Python ----------
"""
Compute liquid transfer coefficients based on absorption coefficient and free 
saturation _w_f
_
This is only an approximation based on Künzel's exponential function. 

    Args:
        _absorpt_coeff: Number for the water absorption coefficient (A) [kg/(m2s1/2)]

        _w_f: Number for the water content at free saturation [kg/m3]
            
    Returns:
        suction_w: A list of moisture contents for the liquid suction [kg/m3]

        suction_coeff: A list of (moisture-dependent) suction coefficients for 
            the liquid suction [m2/s].
            
        redist_w: A list of moisture contents for the liquid redistribution [kg/m3]
        redist_coeff: A list of (moisture-dependent) redistribution coefficients 
            for the liquid redistribution [m2/s].
"""

ghenv.Component.Name = "DB Liquid Coefficients"
ghenv.Component.NickName = 'LiquidCoeff'
ghenv.Component.Message = '0.0.1'
ghenv.Component.Category = 'Dewbee'
ghenv.Component.SubCategory = "1 :: Constructions"

# Turn off the "old" tag
import ghpythonlib as ghlib
c = ghlib.component._get_active_component()
c.ToggleObsolete(False)

try:  # import ladybug_rhino dependencies
    from ladybug_rhino.grasshopper import all_required_inputs
except ImportError as e:
    raise ImportError('\nFailed to import ladybug_rhino:\n\t{}'.format(e))

# Suction liquid transport coefficient
# Based on moisture content (w) and free water saturation (wf)
def suction(A, w_f, w):
    if w <= 0: # start with 0
        return 0.0
    value = 3.8*(A/w_f)**2*1000**(w/w_f - 1)
    return max(value, 1e-15) # avoiding tiny values here
    
# Space moisture points geometrically to increase resolution near wf
def moisture_grid(w_f, n):
    return [w_f*(i/n)**2 for i in range(n+1)]

if all_required_inputs(ghenv.Component):
    n_steps = 10
    suction_w = moisture_grid(_w_f, n_steps)
    suction_coeff = [suction(_absorpt_coeff, _w_f, w) for w in suction_w]
    
    redist_w = suction_w
    redist_coeff = [v/10 for v in suction_coeff]
# ---------- end liquidcoeff ----------
panel_20 = Panel("""0.3285
0.4305
0.5815
0.7558
0.80
0.9406
1""")
panel_21 = Panel("""23.13
27.81
40.31
53.44
61.5
105.63
253.47""")
item_2 = ListItem(List=panel_21, Index="4", Wrap=True)
division = Division(A=item_2, B="1900")
wetconductivity = DBWetThermalConductivity(conductivity_dry="0.643", conductivity_supplement="4.39", density="1900", porosity="0.295")  # -> conductivity_w, conductivity
# ---------- wetconductivity: Python ----------
"""
Generate moisture dependent thermal conductivity using a linear relationship.
conductivity = _conductivity_dry*(1+_conductivity_supplement*w/_bulk_density) 
    Args:
        _conductivity_dry: Number for the dry (10°C) thermal conductivity 
        of the material [W/m-K]
        _conductivity_supplement: Number for the linear supplement of thermal
        conductivity [%/M.-%]
        _porosity: A number between 0 and 1 for the porosity. 
            _
            This is the maximum fraction, by volume, of a material that can be
            taken up with moisture. It is used to calculate the maximum point of 
            conductivity_w.
            
        _density: A number for the dry density of the material [kg/m3]
    Returns:
        conductivity_w: A list of moisture contents for the thermal conductivities [kg/m3]

        conductivity: A list of (moisture-dependent) thermal conductivities [W/m-K]
"""

ghenv.Component.Name = "DB Wet Thermal Conductivity"
ghenv.Component.NickName = 'WetConductivity'
ghenv.Component.Message = '0.0.1'
ghenv.Component.Category = 'Dewbee'
ghenv.Component.SubCategory = "1 :: Constructions"

# Turn off the "old" tag
import ghpythonlib as ghlib
c = ghlib.component._get_active_component()
c.ToggleObsolete(False)

try:  # import ladybug_rhino dependencies
    from ladybug_rhino.grasshopper import all_required_inputs
except ImportError as e:
    raise ImportError('\nFailed to import ladybug_rhino:\n\t{}'.format(e))

# thermal conductivity of moist material
def lambda_w (w, lambda_0, b, rho):
    return lambda_0*(1+b*w/rho)

if all_required_inputs(ghenv.Component):
    w_max = _porosity*1000
    n_steps = 5
    step = w_max/n_steps
    conductivity_w = [i*step for i in range(n_steps+1)]
    conductivity = [lambda_w(w, _conductivity_dry, _conductivity_supplement, _density) 
                    for w in conductivity_w]
# ---------- end wetconductivity ----------
hygromat_5 = DBHygrothermalMaterial(
    mat=opaquemat_5,
    porosity="0.295",
    initial_w=division,
    sorption_w=panel_21,
    sorption_rh=panel_20,
    suction_w=liquidcoeff.suction_w,
    suction_coeff=liquidcoeff.suction_coeff,
    redist_w=liquidcoeff.redist_w,
    redist_coeff=liquidcoeff.redist_coeff,
    diff_rh="0",
    diff_resist="14.34",
    conductivity_w=wetconductivity.conductivity_w,
    conductivity=wetconductivity.conductivity,
    info=panel_19)  # -> mat; inputs sorption_w: list, sorption_rh: list, suction_w: list, suction_coeff: list, redist_w: list, redist_coeff: list, diff_rh: list, diff_resist: list, conductivity_w: list, conductivity: list; same code as hygromat

# ----
thickness_m_2 = Panel("0.06")
panel_22 = Panel("Source: MASEA, XPS Extrudierter Polystyrol-Hartschaum 1 (Kernschicht)")
dry_density_kg_m3_2 = Panel("34")
opaquemat_6 = HBOpaqueMaterial(name="DB XPS", thickness=thickness_m_2, conductivity="0.04", density=dry_density_kg_m3_2, spec_heat="1450")  # -> mat; plug-in component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
hygromat_6 = DBHygrothermalMaterial(mat=opaquemat_6, porosity="0.95", diff_rh="0", diff_resist="70", info=panel_22)  # -> mat; inputs sorption_w: list, sorption_rh: list, suction_w: list, suction_coeff: list, redist_w: list, redist_coeff: list, diff_rh: list, diff_resist: list, conductivity_w: list, conductivity: list; same code as hygromat

panel_23 = Panel("""0
730""")
opaquemat_7 = HBOpaqueMaterial(
    name="DB Spruce",
    thickness="0.012",
    conductivity="0.09",
    density="455",
    spec_heat="1500",
    roughness="Rough",
    therm_absp="0.9",
    sol_absp="0.70",
    vis_absp="0.70")  # -> mat; plug-in component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
panel_24 = Panel("""0.09
0.278""")
panel_25 = Panel("""0
0.00000000000032
0.0000000000092""")
panel_26 = Panel("""0
0.00000000000032
0.0000000000092""")
panel_27 = Panel("Source: EnergyPlus Reference DataSets, MoistureMaterials.idf")
panel_28 = Panel("""0.205
0.4465
0.6515
0.6545
0.83
0.9525
0.956""")
panel_29 = Panel("""25.935
44.3625
61.99375
61.99375
87.1325
119.665
120.12""")
panel_30 = Panel("""0
20
600""")
hygromat_7 = DBHygrothermalMaterial(
    mat=opaquemat_7,
    porosity="0.73",
    initial_w="0.05",
    sorption_w=panel_29,
    sorption_rh=panel_28,
    suction_w=panel_30,
    suction_coeff=panel_25,
    redist_w=panel_30,
    redist_coeff=panel_26,
    diff_rh="0",
    diff_resist="130",
    conductivity_w=panel_23,
    conductivity=panel_24,
    info=panel_27)  # -> mat; inputs sorption_w: list, sorption_rh: list, suction_w: list, suction_coeff: list, redist_w: list, redist_coeff: list, diff_rh: list, diff_resist: list, conductivity_w: list, conductivity: list
# ---------- hygromat_7: Python ----------
"""
Create a hygrothermal opaque material from a standard HB opaque material, which 
can be plugged into the "HB Opaque Construction" component. 
_
Except for _porosity and _initial_w, all hygrothermal inputs must be entered as lists.
_ 
If you don't have enough data, use the standard "HB Opaque Material" instead. 
The HAMT model will only run on surfaces with constructions containing fully 
characterized hygrothermal properties. If all constructions are characterized, 
HAMT will be run for all surfaces.
_
Check MaterialProperty:HeatAndMoistureTransfer on EnergyPlus input-output documentation
for more information on the required inputs.
    Args:
        _mat: A standard HB opaque material object. For example, it can be the
        output of the "HB Opaque Material" component.
            
        _porosity: A number between 0 and 1 for the porosity.
        
        _initial_w_: A number for the initial water content ratio [kg/kg]
             _
             The initial water content is assumed to be distributed evenly through
             the depth of the material. UNITS ARE IN KG OF WATER PER KG OF DRY MATERIAL. (Default: 0)
             
        _sorption_w_: A list of moisture contents for the sorption isotherm [kg/m3]
            This list must have the same length as _sorption_rh. Required for hygroscopic materials.
            _
            EnergyPlus automatically sets w = 0 at rh = 0 and w = porosity*1000 
            at rh=1. If you provide values at rh=0 and rh=1, they override these defaults.
            Therefore, it is recommended to provide a point at rh=1 (w_f), because 
                orption should stop at a lower value, known as free saturation (w_f), because of air pockets
                trapped in the pore structure. For realistic predictions, remember 
            Supply increasing data up to the highest rh available for stability.
            _
            * Default *: when no curve is input, an artificial curve is created based
            on porosity. If at least w_80 and w_f are known, use the GenSorption component.
            
        _sorption_w_: A list of moisture contents for the sorption isotherm [kg/m3]
            This list must have the same length as _sorption_rh. Required for hygroscopic materials.
            _
            EnergyPlus automatically defines endpoints at rh = 0 (w = 0) and adds an
            internal maximum based on porosity. If you provide values at rh = 0 or 1,
            they override these defaults.
            _
            It is recommended to include a point at rh = 1.0 corresponding to free
            saturation (w_f), since real materials typically do not reach full pore
            saturation due to trapped air. This avoids overestimating moisture storage
            in the hygroscopic range.
            _
            Provide monotonically increasing values up to the highest available RH
            for numerical stability.
            _
            *Default*: If no curve is provided, an artificial isotherm is generated
            from porosity. If at least w_80 and w_f are known, use the GenSorption component.
        
        _sorption_rh_: A list of relative humidities between 0 and 1 for the 
            sorption isotherm [-]. Required for hygroscopic materials.
            This list must have the same length as _sorption_w.           
            
        _suction_w_: A list of moisture contents for the liquid suction [kg/m3]
            This list must have the same length as _suction_coeff. Required for capillary-active materials.
            _
            At least a datapoint at w = 0 is needed. The liquid coefficient at 
            the highest entered w is used for all values above this threshold. (Default: 0)

        _suction_coeff_: A list of (moisture-dependent) suction coefficients for 
            the liquid suction [m2/s]. Required for capillary-active materials.
            This list must have the same length as _suction_w
            _
            At least a datapoint at w = 0 is needed. The liquid coefficient at 
            the highest entered w is used for all values above this threshold.
            These coefficients are used when the rain flag is set in the epw. (Default: 0)
            
        _redist_w_: A list of moisture contents for the liquid redistribution [kg/m3].
            Required for capillary-active materials.
            This list must have the same length as _redist_coeff
            _
            At least a datapoint at w = 0 is needed. The liquid coefficient at 
            the highest entered w is used for all values above this threshold. (Default: 0)
            
        _redist_coeff_: A list of (moisture-dependent) redistribution coefficients 
            for the liquid redistribution [m2/s]. Required for capillary-active materials.
            This list must have the same length as _redist_w
             _
            At least a datapoint at w = 0 is needed. The liquid coefficient at 
            the highest entered w is used for all values above this threshold.
            These coefficients are used when the rain flag is NOT set in the epw. (Default: 0)
            
        _diff_rh: A list of relative humidities between 0 and 1 for the vapor 
            diffusion resistance factors [-].
            This list must have the same length as _diff_resist.
            _
            At least a datapoint at rh = 0 is needed. The diffusion resistance 
            factor at the highest entered rh is used for all values above this threshold.
        _diff_resist: A list of (moisture-dependent) vapor diffusion resistance 
            factors [-].
            This list must have the same length as _diff_rh.
            _
            At least a datapoint at rh = 0 is needed. The diffusion resistance 
            factor at the highest entered rh is used for all values above this threshold.
            
        _conductivity_w_: A list of moisture contents for the thermal conductivities [kg/m3]
            This list must have the same length as _conductivity.
            _
            At least a datapoint at w = 0 is needed (dry thermal conductivity). 
            The thermal conductivity at the highest entered w is used for all values 
            above this threshold. (Default: 0)
            
            
        _conductivity_: A list of (moisture-dependent) thermal conductivities [W/m-K] 
            This list must have the same length as _conductivity_w.
            _
            At least a datapoint at w = 0 is needed (dry thermal conductivity). 
            The thermal conductivity at the highest entered w is used for all values 
            above this threshold. (Default: dry conductivity from _mat)
            
        _info_: An optional string describing the material. This can be useful
            to document the source (e.g., MASEA).
    Returns:
        mat: A hygrothermal opaque material that can be assigned to a Honeybee
            Opaque construction.
"""

ghenv.Component.Name = "DB Hygrothermal Material"
ghenv.Component.NickName = 'HygroMat'
ghenv.Component.Message = '0.0.1'
ghenv.Component.Category = 'Dewbee'
ghenv.Component.SubCategory = "0 :: Constructions"

# Turn off the "old" tag
import ghpythonlib as ghlib
c = ghlib.component._get_active_component()
c.ToggleObsolete(False)

# Import dewbee dependencies
from dewbee import hygro_material
from dewbee import utils
reload(hygro_material)
reload(utils)
from dewbee.hygro_material import HygroMaterial
from dewbee.utils import rh_grid

try:  # import the honeybee-energy dependencies
    from honeybee_energy.material.opaque import EnergyMaterial
except ImportError as e:
    raise ImportError('\nFailed to import honeybee_energy:\n\t{}'.format(e))

try:  # import ladybug_rhino dependencies
    from ladybug_rhino.grasshopper import all_required_inputs
except ImportError as e:
    raise ImportError('\nFailed to import ladybug_rhino:\n\t{}'.format(e))

if all_required_inputs(ghenv.Component):
    # Set defaults
    if not _initial_w_:
        _initial_w_ = 0
    # Create artificial sorption curve
    if not _sorption_w_ and not _sorption_rh_:
        _sorption_rh_ = rh_grid()
        w_f = _porosity*0.05*1000 # assume w_f = 0.05*w_max 
        b = 1.01 # keeps the curve very steep
        _sorption_w_ = [w_f*(b-1)*rh/(b-rh) for rh in _sorption_rh_]
    if not _suction_w_ and not _suction_coeff_:
        _suction_w_ = [0]
        _suction_coeff_ = [0]
    if not _redist_w_ and not _redist_coeff_:
        _redist_w_ = [0]
        _redist_coeff_ = [0]
    if not _conductivity_w_ and not _conductivity_:
        _conductivity_w_ = [0]
        _conductivity_ = [_mat.conductivity]
    if not _info_:
        _info_ = ""
    mat = _mat.duplicate()
    identifier = mat.identifier
    hygro_mat = HygroMaterial(
        identifier,
        _porosity,
        _initial_w_,
        _sorption_w_,
        _sorption_rh_,
        _suction_w_,
        _suction_coeff_,
        _redist_w_,
        _redist_coeff_,
        _diff_rh,
        _diff_resist,
        _conductivity_w_,
        _conductivity_,
        )

    #Check if corresponding lists match
    hygro_mat.values_compatible()
    
    print(hygro_mat)
    # Add HygroMaterial object as a dictionary to the standard EnergyMaterial
    mat.user_data = {"hygro_material": hygro_mat.to_dict(),
                     "info": _info_
                    }
# ---------- end hygromat_7 ----------

opaquemat_8 = HBOpaqueMaterial(
    name="DB Plywood",
    thickness="0.025",
    conductivity="0.14",
    density="530",
    spec_heat="1880",
    roughness="Rough",
    therm_absp="0.9",
    sol_absp="0.70",
    vis_absp="0.70")  # -> mat; plug-in component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
panel_31 = Panel("""0
500""")
panel_32 = Panel("""700
200
20""")
panel_33 = Panel("""0.1
0.25""")
panel_34 = Panel("""0
0.5
1""")
panel_35 = Panel("Source: EnergyPlus Reference DataSets, MoistureMaterials.idf")
panel_36 = Panel("""0.2015
0.203
0.435
0.439
0.6495
0.6515
0.8215
0.825
0.9215
0.925
0.9575
0.9605""")
panel_37 = Panel("""3.7125
3.74
5.8025
5.83
7.7825
7.81
10.3675
10.3675
13.1175
13.1175
14.7125
15.345""")
hygromat_8 = DBHygrothermalMaterial(
    mat=opaquemat_8,
    porosity="0.5",
    initial_w="0.05",
    sorption_w=panel_37,
    sorption_rh=panel_36,
    suction_w="0",
    suction_coeff="0",
    redist_w="0",
    redist_coeff="0",
    diff_rh=panel_34,
    diff_resist=panel_32,
    conductivity_w=panel_31,
    conductivity=panel_33,
    info=panel_35)  # -> mat; inputs sorption_w: list, sorption_rh: list, suction_w: list, suction_coeff: list, redist_w: list, redist_coeff: list, diff_rh: list, diff_resist: list, conductivity_w: list, conductivity: list; same code as hygromat

panel_38 = Panel("""0.2
1.424""")
panel_39 = Panel("""0
60
100
160
240
320
360
380
400""")
panel_40 = Panel("""0
0.000000003
0.000000008
0.000000008
0.000000013
0.0000001
0.0000003
0.0000007
0.000001""")
panel_41 = Panel("""0
650""")
panel_42 = Panel("""0
0.000000003
0.0000001
0.0000001
0.00000012
0.00000022
0.0000006
0.0000009
0.00000045""")
panel_43 = Panel("""0
60
100
160
240
320
360
380
400""")

panel_44 = Panel("Source: EnergyPlus Reference DataSets, MoistureMaterials.idf")
opaquemat_9 = HBOpaqueMaterial(
    name="DB Plasterboard",
    thickness="0.012",
    conductivity="0.2",
    density="850",
    spec_heat="850",
    roughness="Rough",
    therm_absp="0.9",
    sol_absp="0.6",
    vis_absp="0.70")  # -> mat; plug-in component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
panel_45 = Panel("""0.202
0.4325
0.6465
0.8465
0.948
0.978""")
panel_46 = Panel("""0.748
1.04
1.24
1.56
1.92
2.72""")
hygromat_9 = DBHygrothermalMaterial(
    mat=opaquemat_9,
    porosity="0.65",
    initial_w="0.1",
    sorption_w=panel_46,
    sorption_rh=panel_45,
    suction_w=panel_43,
    suction_coeff=panel_42,
    redist_w=panel_39,
    redist_coeff=panel_40,
    diff_rh="0",
    diff_resist="8.3",
    conductivity_w=panel_41,
    conductivity=panel_38,
    info=panel_44)  # -> mat; inputs sorption_w: list, sorption_rh: list, suction_w: list, suction_coeff: list, redist_w: list, redist_coeff: list, diff_rh: list, diff_resist: list, conductivity_w: list, conductivity: list; same code as hygromat

water_content_at_rh80_kg_m3_2 = Panel("101")
water_absorption_coefficient_kg_m2h1_2_2 = Panel("0.75")
free_water_saturation_kg_m3_3 = Panel("144")
moisture_content_m3_m3_2 = Panel("""0.02505814
0.029244186
0.045813953
0.080174419
0.101453488
0.150116279
0.150813953""")
dry_density_kg_m3_3 = Panel("2104")
isotherm_rh_2 = Panel("""0.065456674
0.112529274
0.330327869
0.581850117
0.754683841
0.960538642
0.973887588""")
processmasea_2 = DBProcessMASEAData(
    density=dry_density_kg_m3_3,
    absorpt_coeff=water_absorption_coefficient_kg_m2h1_2_2,
    w_80=water_content_at_rh80_kg_m3_2,
    w_f=free_water_saturation_kg_m3_3,
    sorption_w_m3m3=moisture_content_m3_m3_2,
    sorption_rh=isotherm_rh_2)  # -> initial_w, sorption_w, sorption_rh, suction_w, suction_coeff, redist_w, redist_coeff; inputs sorption_w_m3m3: list, sorption_rh: list; same code as processmasea
thickness_m_3 = Panel("0.15")
opaquemat_10 = HBOpaqueMaterial(name="DB Concrete", thickness=thickness_m_3, conductivity="1.94", density=dry_density_kg_m3_3, spec_heat="776")  # -> mat; plug-in component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
hygromat_10 = DBHygrothermalMaterial(
    mat=opaquemat_10,
    porosity="0.172",
    initial_w=processmasea_2.initial_w,
    sorption_w=processmasea_2.sorption_w,
    sorption_rh=processmasea_2.sorption_rh,
    suction_w=processmasea_2.suction_w,
    suction_coeff=processmasea_2.suction_coeff,
    redist_w=processmasea_2.redist_w,
    redist_coeff=processmasea_2.redist_coeff,
    diff_rh="0",
    diff_resist="76.1",
    info="Source: MASEA, Beton")  # -> mat; inputs sorption_w: list, sorption_rh: list, suction_w: list, suction_coeff: list, redist_w: list, redist_coeff: list, diff_rh: list, diff_resist: list, conductivity_w: list, conductivity: list; same code as hygromat

# ---- group: Insulation material
free_water_saturation_kg_m3_4 = Panel("526")
water_content_at_rh80_kg_m3_3 = Panel("17.3")
water_absorption_coefficient_kg_m2h1_2_3 = Panel("0.20")
moisture_content_m3_m3_3 = Panel("""0
0.0125
0.0173
0.025
0.526""")
isotherm_rh_3 = Panel("""0
0.65
0.80
0.93
1""")
dry_density_kg_m3_4 = Panel("168")
holzfaserdämmplatte_1_from_masea = Panel("DB Wood Fiber")
processmasea_3 = DBProcessMASEAData(
    density=dry_density_kg_m3_4,
    absorpt_coeff=water_absorption_coefficient_kg_m2h1_2_3,
    w_80=water_content_at_rh80_kg_m3_3,
    w_f=free_water_saturation_kg_m3_4,
    sorption_w_m3m3=moisture_content_m3_m3_3,
    sorption_rh=isotherm_rh_3)  # -> initial_w, sorption_w, sorption_rh, suction_w, suction_coeff, redist_w, redist_coeff; inputs sorption_w_m3m3: list, sorption_rh: list; same code as processmasea
thickness_m_4 = Panel("0.37")
opaquemat_11 = HBOpaqueMaterial(
    name=holzfaserdämmplatte_1_from_masea,
    thickness=thickness_m_4,
    conductivity="0.04",
    density=dry_density_kg_m3_4,
    spec_heat="1700",
    therm_absp="0.64",
    sol_absp="0.70",
    vis_absp="0.70")  # -> mat; plug-in component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
hygromat_11 = DBHygrothermalMaterial(
    mat=opaquemat_11,
    porosity="0.88",
    initial_w=processmasea_3.initial_w,
    sorption_w=processmasea_3.sorption_w,
    sorption_rh=processmasea_3.sorption_rh,
    suction_w=processmasea_3.suction_w,
    suction_coeff=processmasea_3.suction_coeff,
    redist_w=processmasea_3.redist_w,
    redist_coeff=processmasea_3.redist_coeff,
    diff_rh="0",
    diff_resist="3.3",
    conductivity_w="0",
    conductivity="0.04",
    info="Source: MASEA, Holzfaserdämmplatte 1")  # -> mat; inputs sorption_w: list, sorption_rh: list, suction_w: list, suction_coeff: list, redist_w: list, redist_coeff: list, diff_rh: list, diff_resist: list, conductivity_w: list, conductivity: list; same code as hygromat

# ----
water_absorption_coefficient_kg_m2h1_2_4 = Panel("4.88")
water_content_at_rh80_kg_m3_4 = Panel("15.2")
free_water_saturation_kg_m3_5 = Panel("152")
moisture_content_m3_m3_4 = Panel("""0.00458
0.00530
0.00707
0.00927
0.01515
0.02903
0.03677""")
dry_density_kg_m3_5 = Panel("2058")
isotherm_rh_4 = Panel("""0.0657
0.228
0.330
0.582
0.754
0.96
0.974""")
processmasea_4 = DBProcessMASEAData(
    density=dry_density_kg_m3_5,
    absorpt_coeff=water_absorption_coefficient_kg_m2h1_2_4,
    w_80=water_content_at_rh80_kg_m3_4,
    w_f=free_water_saturation_kg_m3_5,
    sorption_w_m3m3=moisture_content_m3_m3_4,
    sorption_rh=isotherm_rh_4)  # -> initial_w, sorption_w, sorption_rh, suction_w, suction_coeff, redist_w, redist_coeff; inputs sorption_w_m3m3: list, sorption_rh: list; same code as processmasea
thickness_m_5 = Panel("0.06")
opaquemat_12 = HBOpaqueMaterial(name="DB Cement Screed", thickness=thickness_m_5, conductivity="0.97", density=dry_density_kg_m3_5, spec_heat="699")  # -> mat; plug-in component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
hygromat_12 = DBHygrothermalMaterial(
    mat=opaquemat_12,
    porosity="0.265",
    initial_w=processmasea_4.initial_w,
    sorption_w=processmasea_4.sorption_w,
    sorption_rh=processmasea_4.sorption_rh,
    suction_w=processmasea_4.suction_w,
    suction_coeff=processmasea_4.suction_coeff,
    redist_w=processmasea_4.redist_w,
    redist_coeff=processmasea_4.redist_coeff,
    diff_rh="0",
    diff_resist="83.7",
    info="Source: MASEA, Fliessestrich FE 50")  # -> mat; inputs sorption_w: list, sorption_rh: list, suction_w: list, suction_coeff: list, redist_w: list, redist_coeff: list, diff_rh: list, diff_resist: list, conductivity_w: list, conductivity: list; same code as hygromat

path = FilePath("C:\Users\gzorzeto\Documents\GitHub_repos\dewbee_main\resources\standards\")

water_absorption_coefficient_kg_m2h1_2_5 = Panel("0")
water_content_at_rh80_kg_m3_5 = Panel("60")
free_water_saturation_kg_m3_6 = Panel("575")
moisture_content_m3_m3_5 = Panel("""0.030303692
0.057660924
0.086559384
0.113145967
0.574""")
dry_density_kg_m3_6 = Panel("400")
isotherm_rh_5 = Panel("""0.499139772
0.798924672
0.899139746
0.969247242
0.999354819""")
thickness_m_6 = Panel("0.02")
opaquemat_13 = HBOpaqueMaterial(name="DB Softwood", thickness=thickness_m_6, conductivity="0.09", density=dry_density_kg_m3_6, spec_heat="1500")  # -> mat; plug-in component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
panel_47 = Panel("""0.249377849
0.498395516
0.60055661
0.699738031
0.900229179
0.99855931""")
panel_48 = Panel("""180.714287
64.86607655
44.64287181
29.64285649
20
10.35714351""")

processmasea_5 = DBProcessMASEAData(
    density=dry_density_kg_m3_6,
    absorpt_coeff=water_absorption_coefficient_kg_m2h1_2_5,
    w_80=water_content_at_rh80_kg_m3_5,
    w_f=free_water_saturation_kg_m3_6,
    sorption_w_m3m3=moisture_content_m3_m3_5,
    sorption_rh=isotherm_rh_5)  # -> initial_w, sorption_w, sorption_rh, suction_w, suction_coeff, redist_w, redist_coeff; inputs sorption_w_m3m3: list, sorption_rh: list; same code as processmasea

hygromat_13 = DBHygrothermalMaterial(
    mat=opaquemat_13,
    porosity="0.73",
    initial_w=processmasea_5.initial_w,
    sorption_w=processmasea_5.sorption_w,
    sorption_rh=processmasea_5.sorption_rh,
    suction_w=processmasea_5.suction_w,
    suction_coeff=processmasea_5.suction_coeff,
    redist_w=processmasea_5.redist_w,
    redist_coeff=processmasea_5.redist_coeff,
    diff_rh=panel_47,
    diff_resist=panel_48,
    info="Source: MASEA, Weichholz")  # -> mat; inputs sorption_w: list, sorption_rh: list, suction_w: list, suction_coeff: list, redist_w: list, redist_coeff: list, diff_rh: list, diff_resist: list, conductivity_w: list, conductivity: list; same code as hygromat

path_2 = FilePath("C:\Users\gzorzeto\AppData\Roaming\ladybug_tools\standards\constructions\")
merge = Merge(
    Data1=hygromat_11,
    Data2=hygromat_2,
    Data3=hygromat,
    Data4=hygromat_5,
    Data5=hygromat_10,
    Data6=hygromat_6,
    Data7=hygromat_12,
    Data8=hygromat_13,
    Data9=hygromat_7,
    Data10=hygromat_8,
    Data11=hygromat_4,
    Data12=hygromat_3,
    Data13=hygromat_9)  # -> flatten(Result)
dumpmergeobjects = DBDumpOrMergeObjects(hb_objs=flatten(merge), name="dewbee_materials", folder=[path_2, path], indent="1", dump=Toggle(True))  # -> out, hb_file; inputs hb_objs: list, indent: Int32, abridged: Boolean, dump: Boolean
#   port out: Errors, warnings, etc.
# ---------- dumpmergeobjects: Python ----------
"""
Dump any honeybee object to a JSON file. You can use "HB Load Objects" component
to load the objects from the file back into Grasshopper.
-
This version adds merge behavior for object-library JSON files:
If the target file does not exist, it is created.
If the target file exists and contains a JSON object/dictionary, objects with
matching identifiers are replaced and new ones are appended.
If a single Honeybee Model is written, the file is overwritten as usual.
-

    Args:
        _hb_objs: A list of Honeybee objects to be written to a file.
        _name_: A name for the file to which the honeybee objects will be written.
            (Default: 'unnamed').
        _folder_: An optional directory into which the honeybee objects will be
            written. The default is set to the default simulation folder.
        indent_: An optional positive integer to set the indentation used in the
            resulting JSON file.
        abridged_: Set to "True" to serialize the object in its abridged form.
        _dump: Set to "True" to save the honeybee objects to file.
    
    Returns:
        report: Errors, warnings, and info about added/replaced objects.
        hb_file: The location of the file where the honeybee JSON is saved.
"""

ghenv.Component.Name = 'DB Dump or Merge Objects'
ghenv.Component.NickName = 'DumpMergeObjects'
ghenv.Component.Message = '0.0.1'
ghenv.Component.Category = 'Dewbee'
ghenv.Component.SubCategory = '0 :: Miscellaneous'

import os
import sys
import json
import codecs

try:  # import the core honeybee dependencies
    from honeybee.model import Model
    from honeybee.room import Room
    from honeybee.face import Face
    from honeybee.aperture import Aperture
    from honeybee.door import Door
    from honeybee.shade import Shade
    from honeybee.config import folders
except ImportError as e:
    raise ImportError('\nFailed to import honeybee:\n\t{}'.format(e))

try:  # import the core ladybug_rhino dependencies
    from ladybug_rhino.grasshopper import all_required_inputs, give_warning
except ImportError as e:
    raise ImportError('\nFailed to import ladybug_rhino:\n\t{}'.format(e))


def geo_object_warning(obj):
    """Give a warning that individual geometry objects should be added to a Model."""
    msg = 'An individual {} has been connected to the _hb_objs.\n' \
        'The recommended practice is to add this object to a Model and\n' \
        'serialize the Model instead of serializing individual objects.'.format(
            obj.__class__.__name__)
    print(msg)
    give_warning(ghenv.Component, msg)


def obj_to_dict(obj, abridged=False):
    """Serialize a Honeybee object to a dictionary."""
    try:
        return obj.to_dict(abridged=abridged)
    except TypeError:
        return obj.to_dict()


def open_utf8_read(path):
    """Open a UTF-8 file for reading in IronPython/Python 2."""
    return codecs.open(path, 'r', 'utf-8')


def open_utf8_write(path):
    """Open a UTF-8 file for writing in IronPython/Python 2."""
    return codecs.open(path, 'w', 'utf-8')


def load_existing_library(path):
    """Load an existing JSON library file.

    Returns:
        {} if file does not exist.
        Existing dictionary if valid.

    Raises:
        ValueError if the existing file is not a dictionary-based object library.
    """
    if not os.path.isfile(path):
        return {}

    with open_utf8_read(path) as fp:
        data = json.load(fp)

    if not isinstance(data, dict):
        raise ValueError(
            'Existing JSON file is not a dictionary-based object library.\n'
            'Merge is only supported for JSON files storing objects keyed by identifier.'
        )

    return data


def write_json(path, data, indent):
    """Write JSON to file as UTF-8."""
    with open_utf8_write(path) as fp:
        json.dump(data, fp, indent=indent, ensure_ascii=False)


if all_required_inputs(ghenv.Component) and _dump:
    report_msgs = []

    # set defaults
    name = _name_ if _name_ is not None else 'unnamed'
    folder = _folder_ if _folder_ is not None else folders.default_simulation_folder
    abridged = bool(abridged_)
    indent = indent_ if indent_ is not None else 4

    # choose file extension
    file_name = '{}.json'.format(name) if len(_hb_objs) > 1 or not \
        isinstance(_hb_objs[0], Model) else '{}.hbjson'.format(name)
    hb_file = os.path.join(folder, file_name)

    # warn about individual geometry objects
    geo_types = (Room, Face, Aperture, Door, Shade)
    for obj in _hb_objs:
        if isinstance(obj, geo_types):
            geo_object_warning(obj)

    # ensure output folder exists
    if not os.path.isdir(folder):
        os.makedirs(folder)

    # CASE 1: single Model -> overwrite as normal
    if len(_hb_objs) == 1 and isinstance(_hb_objs[0], Model):
        obj_dict = obj_to_dict(_hb_objs[0], abridged)
        write_json(hb_file, obj_dict, indent)
        report_msgs.append('Wrote single Model to file (overwrite mode).')

    # CASE 2: library/object dump -> merge by identifier
    else:
        # serialize incoming objects
        new_obj_dict = {}
        for obj in _hb_objs:
            try:
                obj_id = obj.identifier
            except AttributeError:
                raise ValueError(
                    'One of the connected objects does not have an "identifier" '
                    'attribute and cannot be stored in the library.'
                )
            new_obj_dict[obj_id] = obj_to_dict(obj, abridged)

        # load existing library, if any
        try:
            existing_obj_dict = load_existing_library(hb_file)
        except Exception as e:
            raise ValueError(
                'Failed to load existing JSON library file:\n{}\nPath: {}'.format(e, hb_file)
            )

        # determine added vs replaced BEFORE update
        added = []
        replaced = []
        for obj_id in new_obj_dict:
            if obj_id in existing_obj_dict:
                replaced.append(obj_id)
            else:
                added.append(obj_id)

        # merge
        existing_obj_dict.update(new_obj_dict)

        # write merged result
        write_json(hb_file, existing_obj_dict, indent)

        # report
        report_msgs.append('Merged objects into existing library.')
        report_msgs.append('Added: {}'.format(len(added)))
        report_msgs.append('Replaced: {}'.format(len(replaced)))

        if len(added) != 0:
            report_msgs.append('Added identifiers: {}'.format(', '.join(sorted(added))))
        if len(replaced) != 0:
            report_msgs.append('Replaced identifiers: {}'.format(', '.join(sorted(replaced))))

    report = '\n'.join(report_msgs)
    print(report)
# ---------- end dumpmergeobjects ----------
